# Grasshopper definition 01_SaddleNet.ghx (Grasshopper 1.0.8)
# plug-ins: Arachne

cavi = Curve([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])
vincoli = Point([Point(0, 0, 2000), Point(2500, 0, 1000), Point(5000, 0, 0), Point(7500, 0, -1000), Point(10000, 0, -2000), Point(0, 2500, 1000), Point(10000, 2500, -1000), Point(0, 5000, 0), Point(10000, 5000, 0), Point(0, 7500, -1000), Point(10000, 7500, 1000), Point(0, 10000, -2000), Point(2500, 10000, -1000), Point(5000, 10000, 0), Point(7500, 10000, 1000), Point(10000, 10000, 2000)])
riferimento_gpc = CoordinateSystem(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)
# ARACHNE | 01 Sella (N, mm)
# Rete 10 x 10 m, 4 x 4 campi, bordo vincolato con quote +/-2 m agli angoli.
# Beam (proprieta Cable, sezione piena D 10 mm, acciaio) + Force Density 1 N/mm, caso di carico FF.
# Build Model in N/mm -> Check Model -> Form Find lineare (Solver Options con i valori predefiniti) -> Beam Forces (tiri, N) e Support Reactions (N).
# Auto Run disattivato: risultati salvati; usare Run per ricalcolare.
# ARACHNE 0.4 | Archivio GPC
# Auto Run disattivato: all'apertura si ripristinano i risultati salvati.
# Per modificare il modello: Run oppure attivare Auto Run. Copiare anche il file .gpc-results.
lc = LoadCase(Name="FF")
sc = SolidCircle(Diameter=10)
sm = Steel(Name="Steel", Grade=0)
bp = BeamProperty(Name="Cable", Type=1, Section=sc, Material=sm, Name_2="Cable", Type_2=1, Section_2=sc, Material_2=sm, Release=1)  # -> Property, Property_2
bm = Beam(Line=cavi, Property=bp.Property_2, Angle=0)
fd = ForceDensity(Beam=bm, Type=0, LoadCase=lc, Value=1, Project=False, Weight=1)
N = Node(Point=vincoli)
nr = Restraints(Node=N, Translational=[True, True, True])
bm_2 = BuildModel(Elements=flatten([fd, nr]), Units=2)
ckm = CheckModel(Model=bm_2)  # -> Valid, Errors, Warnings, Parts
so = SolverOptions(Gravity=0, Pressure=0, MaxIter=20, Tolerance=0.0001, MaxIterS=0, ToleranceAS=1e-06, ToleranceBS=1e-06, CreateMesh=True)
auto_run = BooleanToggle(False)
ff = FormFind(Model=bm_2, SolverType=0, Options=so, Plane=PlaneXY(0, 0, 0), AutoRun=auto_run, GpcAnalyses_Version=1)  # -> Model, Mesh
bf = BeamForces(Model=ff.Model)  # -> Lines, AxialForces, ForceDensities, Lengths, IDs
sr = SupportReactions(Model=ff.Model)  # -> Points, Reactions, IDs, Total
