# Grasshopper definition 02_Patterning.ghx (Grasshopper 1.0.8)
# plug-ins: Arachne

pannello_3d = Mesh(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)
# ARACHNE | Pannelli
# Mesh inclinata -> sviluppo -> compensazione 2% / 1% -> bordi -> decompensazione -> disposizione.
# I quattro descrittori sono neutri (0). Scale dei descrittori in frazione: 0.02 = 2%.
# ARAP e un percorso alternativo. Le unita sono quelle delle coordinate.
F = Flattening(Mesh=pannello_3d, BorderWeight=1, MaxIterNL=20, ToleranceNL=0.01, MaxIterS=10000, ToleranceS=0)
fa = FlatteningARAP(
    Mesh=pannello_3d,
    UnwrapIterations=1000,
    PerimeterIterations=1000,
    PerimeterTolerance=0.5,
    AngleTolerance=2.748893572,
    ConvergenceSpeed=0.1)
C = Compensation(
    Panel=F,
    WarpDirection=Vector(1, 0, 0),
    WaScale=2,
    WeScale=1,
    MaxIterNL=20,
    ToleranceNL=0.0001,
    MaxIterS=10000,
    ToleranceS=0.0001)
bs = Borders(Mesh=C, Angle=degrees(15), Smooth=False)
ob = OrderBorders(Curves=bs, ClockWise=False)
dd = DecompensationDescriptor(Length=0.1, Normalized=True, XScaleEnds=[0, 0, 0, 0], XScaleCenter=0, YScaleEnds=0, YScaleCenter=0)
dc = Decompensation(Curves=ob, Descriptors=dd)
lu = LineUp(Geometry=dc, Line=Line((0, 0, 0), (1, 0, 0)), Spacing=0.2, MinimalBounding=True)  # -> Geometry, Box
