# Grasshopper definition 03_CableNet.ghx (Grasshopper 1.0.8)
# plug-ins: Arachne

perimetro = Curve([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])
riferimento_gpc = CoordinateSystem(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)
# ARACHNE | 03 Cable Net (N, mm)
# Perimetro a sella 12 x 8 m, maglia 1 x 1 m. Ordito q = 2 N/mm, trama q = 1 N/mm, bordo vincolato.
# Le linee di bordo vincolate (Restraint edges) entrano come Beam per chiudere le maglie della mesh.
# Build Model in N/mm -> Form Find lineare con mesh (Solver Options con i valori predefiniti).
# ARACHNE 0.4 | Archivio GPC
# Auto Run disattivato: all'apertura si ripristinano i risultati salvati.
# Per modificare il modello: Run oppure attivare Auto Run. Copiare anche il file .gpc-results.
lc = LoadCase(Name="FF")
sc = SolidCircle(Diameter=10)
sm = Steel(Name="Steel", Grade=0)
bp = BeamProperty(Name="Cable", Type=1, Section=sc, Material=sm, Name_2="Cable", Type_2=1, Section_2=sc, Material_2=sm, Release=1)  # -> Property, Property_2
cn = CableNet(
    RestraintEdges=perimetro,
    Perimeter=perimetro,
    WarpStep=1000,
    WeftStep=1000,
    Plane=PlaneXY(0, 0, 0),
    Origin=Point(0, 0, 0),
    Angle=0,
    Tolerance=0.001,
    Match=0)  # -> RestraintEdges, FreeEdges, Warp, Weft, RestraintPoints, NotRestraintPoints, InternalPoints
bm = Beam(Line=flatten(cn.Warp), Property=bp.Property_2, Angle=0)
bm_2 = Beam(Line=flatten(cn.Weft), Property=bp.Property_2, Angle=0)
bm_3 = Beam(Line=flatten(cn.RestraintEdges), Property=bp.Property_2, Angle=0)
fd = ForceDensity(Beam=bm, Type=0, LoadCase=lc, Value=2, Project=False, Weight=1)
fd_2 = ForceDensity(Beam=bm_2, Type=0, LoadCase=lc, Value=1, Project=False, Weight=1)
fd_3 = ForceDensity(Beam=bm_3, Type=0, LoadCase=lc, Value=1, Project=False, Weight=1)
N = Node(Point=cn.RestraintPoints)
nr = Restraints(Node=N, Translational=[True, True, True])
bm_4 = BuildModel(Elements=flatten([fd, fd_2, fd_3, nr]), Units=2)
so = SolverOptions(Gravity=0, Pressure=0, MaxIter=20, Tolerance=0.0001, MaxIterS=0, ToleranceAS=1e-06, ToleranceBS=1e-06, CreateMesh=True)
auto_run = BooleanToggle(False)
ff = FormFind(Model=bm_4, SolverType=0, Options=so, Plane=PlaneXY(0, 0, 0), AutoRun=auto_run, GpcAnalyses_Version=1)  # -> Model, Mesh
