# Grasshopper definition 03_Rectangular_Iterative.ghx (Grasshopper 1.0.8)
# plug-ins: Arachne

# ---- group: 01 / GEOMETRIA
bordo_a_sella_m = Curve([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])
passo_warp_m = Slider(2, range=1..3)
passo_weft_m = Slider(2, range=1..3)
# 03 | RETE RETTANGOLARE ITERATIVA
# Warp 6 kN / weft 3 kN · carichi sui cavi · geometria in metri
cn = CableNet(
    RestraintEdges=bordo_a_sella_m,
    Perimeter=bordo_a_sella_m,
    WarpStep=passo_warp_m,
    WeftStep=passo_weft_m,
    Plane=PlaneXY(0, 0, 0),
    Origin=Point(0, 0, 0),
    Angle=0,
    Tolerance=1e-06,
    Match=0)  # -> RestraintEdges, FreeEdges, Warp, Weft, RestraintPoints, NotRestraintPoints, InternalPoints

# ---- group: 02 / TIRI E VINCOLI
cavi_bordo_vincolato = Cable(
    Line=flatten(cn.RestraintEdges),
    Target=5000,
    Kind=0,
    Project=False,
    TargetWeight=0,
    Direction=-1,
    Chord=0,
    Area=0,
    Density=0)
vincoli_perimetrali_xyz = NodeConditions(
    Point=flatten(cn.RestraintPoints),
    FixX=True,
    FixY=True,
    FixZ=True,
    Force=Vector(0, 0, 0),
    PositionWeight=Vector(0, 0, 0))
# -100 N a meta di ogni segmento warp.
# Cable Load riceve una forza concentrata, non N/m.
tiro_warp_n = Slider(6000, range=1000..15000)
cable_warp = Cable(
    Line=flatten(cn.Warp),
    Target=tiro_warp_n,
    Kind=1,
    Project=False,
    TargetWeight=0,
    Direction=0,
    Chord=0,
    Area=0,
    Density=0)
tiro_imposto_warp = CableConstraints(Cable=cable_warp, Length=0, Force=tiro_warp_n, Weight=1, Compensation=0)
tiro_weft_n = Slider(3000, range=1000..15000)
cable_weft = Cable(
    Line=flatten(cn.Weft),
    Target=tiro_weft_n,
    Kind=1,
    Project=False,
    TargetWeight=0,
    Direction=1,
    Chord=0,
    Area=0,
    Density=0)
tiro_imposto_weft = CableConstraints(Cable=cable_weft, Length=0, Force=tiro_weft_n, Weight=1, Compensation=0)

# ----
load_c = CableLoad(Cable=tiro_imposto_warp, Force=Vector(0, 0, -100), Position=0.5)

# ---- group: 03 / MODELLO E SOLUZIONE
model = Model(
    Cables=flatten([load_c, tiro_imposto_weft, cavi_bordo_vincolato]),
    Conditions=flatten(vincoli_perimetrali_xyz),
    Tolerance=1e-06)  # -> Model, Nodes, Cables
chk = CheckModel(Model=model.Model)  # -> Valid, Errors, Warnings, Parts
dm = DeconstructModel(Model=model.Model)  # -> ModelID, Nodes, NodeIDs, Cables, CableIDs, Connectivity, Plates, Restraints, AppliedForces, CableData
settings = SolverSettings(
    Solver=1,
    MaxIterations=500,
    Tolerance=1e-07,
    Gravity=0,
    Pressure=0,
    CreateMesh=True,
    Plane=PlaneXY(0, 0, 0),
    AlgebraicIterations=0,
    AlgebraicToleranceA=1e-07,
    AlgebraicToleranceB=0)
calcola_run = BooleanToggle(True)
ff = FormFind(Model=model.Model, Settings=settings, Run=calcola_run, Background=False, Cancel=False)  # -> Nodes, Cables, Mesh, AxialForces, ForceDensities, PressureForces, Status, Log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

# ---- group: 04 / RISULTATI E CONTROLLO
dr = DeconstructResult(Result=ff.Result)  # -> InitialModel, SolvedModel, Status, Log, ID, InternalIterations
nr = NodeResults(Result=ff.Result)  # -> IDs, Positions, Displacement, ExternalForce, Reaction, Residual, Pressure, SelfWeight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
br = BeamResults(Result=ff.Result)  # -> IDs, Axes, StartNode, EndNode, AxialForce, ForceDensity, Length, InitialLength, CableRecords
pr = PlateResults(Result=ff.Result)  # -> IDs, Plates, NodeIDs, BoundaryCableIDs, BoundaryAxialForces, Area, InitialArea, MembraneResultsAvailable, MembraneStatus, PlateRecords
eq = EquilibriumReport(Result=ff.Result, ForceTolerance=0.1, MomentTolerance=1, Origin=Point(0, 0, 0))  # -> Accepted, External, Reactions, ForceImbalance, MomentImbalance, MaxResidual
hist = SolverHistory(Result=ff.Result)  # -> Outer, Inner, Criterion, Metric, Elapsed
preview = ResultPreview(Result=ff.Result, Field=0)  # -> Cables, Colors, Values, Legend

# ----
units = UnitSettings(Length=2, Force=2, Mass=0)  # -> Units, LengthFactor, ForceFactor, PressureFactor
si = ConvertUnits(Values=br.AxialForce, Units=units.Units, Quantity=2, ToSI=False)
dll = DependencyCheck(CheckARAP=True)  # -> Available, Report
dll_disponibili = Panel(dll.Available)
stesse_forze_in_kn = Panel(si)
# Solver: LinearIterative
# Tiri imposti: warp / weft separati.
# Cambiare i due slider e controllare i risultati.
# Run=False azzera i risultati.
esito = Panel(ff.Status)
forze_aste_n = Panel(br.AxialForce)
# I tiri delle piastre sono le forze nelle aste di bordo.
# Nx, Ny, Nxy non sono disponibili.
# ID di nodi, aste e piastre: numerazione da 1.
equilibrio_verificato = Panel(eq.Accepted)
forze_bordi_piastre_n = Panel(pr.BoundaryAxialForces)
