# Grasshopper definition 06_Compound_Nonlinear.ghx (Grasshopper 1.0.8)
# plug-ins: Arachne

# ---- group: 01 / GEOMETRIA MULTIPANNELLO
due_bordi_rami_0_1 = Curve(Tree({0}: [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], {1}: [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]))
# 06 | RETE COMPOSTA NON LINEARE
# Due pannelli indipendenti, ciascuno con bordo vincolato · warp 6 kN / weft 2.5 kN
compnet = CompoundNet(
    RestraintEdges=due_bordi_rami_0_1,
    Perimeter=due_bordi_rami_0_1,
    WarpStep=[1, 1],
    WeftStep=[1, 1],
    Kind=[0, 0],
    Origin=[Point(0, 0, 0), Point(6, 0, 0)],
    Angle=0,
    Tolerance=1e-05,
    Match=0,
    Discretization=6)  # -> RestraintEdges, FreeEdges, Warp, Weft, RestraintPoints, NotRestraintPoints, InternalPoints

# ---- group: 02 / TIRI E VINCOLI
cavi_bordo_vincolato = Cable(
    Line=flatten(compnet.RestraintEdges),
    Target=5000,
    Kind=0,
    Project=False,
    TargetWeight=0,
    Direction=-1,
    Chord=0,
    Area=0,
    Density=0)
vincoli_perimetrali_xyz = NodeConditions(
    Point=flatten(compnet.RestraintPoints),
    FixX=True,
    FixY=True,
    FixZ=True,
    Force=Vector(0, 0, 0),
    PositionWeight=Vector(0, 0, 0))
tiro_warp_n = Slider(6000, range=1000..15000)
cable_warp = Cable(
    Line=flatten(compnet.Warp),
    Target=tiro_warp_n,
    Kind=1,
    Project=False,
    TargetWeight=0,
    Direction=0,
    Chord=0,
    Area=0,
    Density=0)
tiro_imposto_warp = CableConstraints(Cable=cable_warp, Length=0, Force=tiro_warp_n, Weight=1, Compensation=0)
tiro_weft_n = Slider(2500, range=1000..15000)
cable_weft = Cable(
    Line=flatten(compnet.Weft),
    Target=tiro_weft_n,
    Kind=1,
    Project=False,
    TargetWeight=0,
    Direction=1,
    Chord=0,
    Area=0,
    Density=0)
tiro_imposto_weft = CableConstraints(Cable=cable_weft, Length=0, Force=tiro_weft_n, Weight=1, Compensation=0)

# ---- group: 03 / MODELLO E SOLUZIONE
model = Model(
    Cables=flatten([tiro_imposto_warp, tiro_imposto_weft, cavi_bordo_vincolato]),
    Conditions=flatten(vincoli_perimetrali_xyz),
    Tolerance=1e-06)  # -> Model, Nodes, Cables
chk = CheckModel(Model=model.Model)  # -> Valid, Errors, Warnings, Parts
dm = DeconstructModel(Model=model.Model)  # -> ModelID, Nodes, NodeIDs, Cables, CableIDs, Connectivity, Plates, Restraints, AppliedForces, CableData
settings = SolverSettings(
    Solver=2,
    MaxIterations=500,
    Tolerance=1e-07,
    Gravity=0,
    Pressure=0,
    CreateMesh=True,
    Plane=PlaneXY(0, 0, 0),
    AlgebraicIterations=0,
    AlgebraicToleranceA=1e-07,
    AlgebraicToleranceB=0)
calcola_run = BooleanToggle(True)
ff = FormFind(Model=model.Model, Settings=settings, Run=calcola_run, Background=False, Cancel=False)  # -> Nodes, Cables, Mesh, AxialForces, ForceDensities, PressureForces, Status, Log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

# ---- group: 04 / RISULTATI E CONTROLLO
dr = DeconstructResult(Result=ff.Result)  # -> InitialModel, SolvedModel, Status, Log, ID, InternalIterations
nr = NodeResults(Result=ff.Result)  # -> IDs, Positions, Displacement, ExternalForce, Reaction, Residual, Pressure, SelfWeight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
br = BeamResults(Result=ff.Result)  # -> IDs, Axes, StartNode, EndNode, AxialForce, ForceDensity, Length, InitialLength, CableRecords
pr = PlateResults(Result=ff.Result)  # -> IDs, Plates, NodeIDs, BoundaryCableIDs, BoundaryAxialForces, Area, InitialArea, MembraneResultsAvailable, MembraneStatus, PlateRecords
eq = EquilibriumReport(Result=ff.Result, ForceTolerance=0.1, MomentTolerance=1, Origin=Point(0, 0, 0))  # -> Accepted, External, Reactions, ForceImbalance, MomentImbalance, MaxResidual
hist = SolverHistory(Result=ff.Result)  # -> Outer, Inner, Criterion, Metric, Elapsed
preview = ResultPreview(Result=ff.Result, Field=0)  # -> Cables, Colors, Values, Legend

# ----
# Solver: NonLinear
# Tiri imposti: warp / weft separati.
# Cambiare i due slider e controllare i risultati.
# Run=False azzera i risultati.
esito = Panel(ff.Status)
forze_aste_n = Panel(br.AxialForce)
# I tiri delle piastre sono le forze nelle aste di bordo.
# Nx, Ny, Nxy non sono disponibili.
# ID di nodi, aste e piastre: numerazione da 1.
equilibrio_verificato = Panel(eq.Accepted)
forze_bordi_piastre_n = Panel(pr.BoundaryAxialForces)
