# Grasshopper definition 07_Patterning_Workshop.ghx (Grasshopper 1.0.8)
# plug-ins: Arachne

# ---- group: 02 / SVILUPPO E COMPENSAZIONE
pannello_piano_2_x_2_m = Mesh(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)
# 07 | DAL FORM FINDING AI PANNELLI
# Sella dimostrativa + laboratorio di sviluppo, compensazione, taglio e rimappatura
mc = MeshClean(Mesh=pannello_piano_2_x_2_m, Length=1, Area=0, Angle=2.5)
F = Flattening(Mesh=mc, BorderWeight=1, MaxIterNL=20, ToleranceNL=0.01, MaxIterS=10000, ToleranceS=0)
C = Compensation(
    Panel=F,
    WarpDirection=Vector(1, 0, 0),
    WaScale=2,
    WeScale=1,
    MaxIterNL=20,
    ToleranceNL=0.0001,
    MaxIterS=10000,
    ToleranceS=0.0001)
bs = Borders(Mesh=C, Angle=degrees(15), Smooth=False)
ob = OrderBorders(Curves=bs, ClockWise=False)
dd = DecompensationDescriptor(Length=0.1, Normalized=True, XScaleEnds=0.02, XScaleCenter=0, YScaleEnds=0, YScaleCenter=0)
dc = Decompensation(Curves=graft(ob), Descriptors=dd)
dde = DecompensationDescriptorExt(Length=[0, 0.5, 1], Normalized=[True, True, True], XScale=[0, 0.01, 0], YScale=[0, 0, 0])
decompensazione_variabile = Decompensation(Curves=graft(ob), Descriptors=dde)
lu = LineUp(Geometry=flatten([dc, decompensazione_variabile]), Line=Line((0, 0, 0), (1, 0, 0)), Spacing=0.3, MinimalBounding=True)  # -> Geometry, Box

# ---- group: 01 / PANNELLO DALLA RETE RISOLTA
demo = DemoSaddleNet(Divisions=3, Span=6, Rise=0.5)  # -> Lines, Supports, Faces
cable = Cable(Line=demo.Lines, Target=1500, Kind=0, Project=False, TargetWeight=0, Direction=-1, Chord=0, Area=0, Density=0)
node = NodeConditions(Point=demo.Supports, FixX=True, FixY=True, FixZ=True, Force=Vector(0, 0, 0), PositionWeight=Vector(0, 0, 0))
model = Model(Cables=flatten(cable), Conditions=flatten(node), Faces=demo.Faces, Tolerance=1e-06)  # -> Model, Nodes, Cables
calcola_run = BooleanToggle(True)
ff = FormFind(Model=model.Model, Run=calcola_run, Background=False, Cancel=False)  # -> Nodes, Cables, Mesh, AxialForces, ForceDensities, PressureForces, Status, Log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
pr = PlateResults(Result=ff.Result, IDs=1)  # -> IDs, Plates, NodeIDs, BoundaryCableIDs, BoundaryAxialForces, Area, InitialArea, MembraneResultsAvailable, MembraneStatus, PlateRecords
fa = FlatteningARAP(
    Mesh=pr.Plates,
    UnwrapIterations=1000,
    PerimeterIterations=1000,
    PerimeterTolerance=0.001,
    AngleTolerance=2.748893572,
    ConvergenceSpeed=0.1)  # -> Flatten, Status, Report, Energy, EdgeDistortion, PerimeterError
dist = PanelDistortion(Original=pr.Plates, Developed=fa.Flatten, EdgeTolerance=0.02, AreaTolerance=0.04)  # -> Accepted, Edges, LengthChanges, AreaChanges, MaxLengthChange, MaxAreaChange

# ---- group: 03 / MESH, DEFORMAZIONE E GEODETICHE
diagonale_da_separare = Curve(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)
mc_2 = SubdivideMesh(Mesh=pannello_piano_2_x_2_m, Subdivisions=1)
da = DeformARAP(
    Mesh=mc_2,
    Iterations=1000,
    PinnedVertices=[0, 1, 2, 3],
    PinPositions=[Point(1, 1, 0), Point(3, 1, 0), Point(3, 3, 0.3), Point(1, 3, 0)],
    Force2D=False)  # -> Deformed, Status, Report, Energy, EdgeDistortion
mr = MeshRemap(MeshA=mc_2, MeshB=da.Deformed, GeometryA=Point(2, 2, 0), CurveSamples=100, Tolerance=100)  # -> AToB, BToA
mg = MeshGeodesic(Mesh=pannello_piano_2_x_2_m, From=Point(2, 1, 0), To=Point(2, 3, 0), Resolution=0.25, Iterations=10)
md = MeshDivide(Mesh=pannello_piano_2_x_2_m, Number=2, Rotation=0, Resolution=0.25, Iterations=10)
go = GeodesicOffsets(
    Mesh=pannello_piano_2_x_2_m,
    Geodesic=mg,
    Side=1,
    Distance=0.5,
    Tolerance=0.01,
    Resolution=0.25,
    Iterations=10,
    Vertical=True)  # -> Geodesics, Mesh, FlattenMesh
sm = SplitMeshOnCurves(Mesh=pannello_piano_2_x_2_m, Geodesics=md, Extend=10, Height=100, Direction=Vector(0, 0, 1))  # -> Panels, Cutters
um = UnweldMesh(Mesh=pannello_piano_2_x_2_m, Curves=diagonale_da_separare, Tolerance=0.01)
mp = MeshPipe(Line=flatten(ff.Cables), Radius=0.025, Edges=4)

# ----
# Compensazione: 2% warp, 1% weft.
# Descrittori: frazioni, 0.02 = 2%.
# Due decompensazioni alternative sullo stesso bordo.
distorsione_pannello = Panel(dist.MaxLengthChange)
